# Dynamo graph floor_get_floor_sketch_area.dyn (Dynamo 2.16.2.5624)

select_model_elements = DSModelElementsSelection()  # 5 picked in the model
code_block = CodeBlock { "Comments"; }
getSketchCurves = Python(IN[0]=select_model_elements)  # "Floor.GetSketchCurves"; IronPython2
# ---------- getSketchCurves.python (88 lines) ----------
import clr
import sys
sys.path.append('C:\Program Files (x86)\IronPython 2.7\Lib')
import System
from System import Array
from System.Collections.Generic import *
clr.AddReference('ProtoGeometry')
from Autodesk.DesignScript.Geometry import *
clr.AddReference("RevitNodes")
import Revit
clr.ImportExtensions(Revit.Elements)
clr.ImportExtensions(Revit.GeometryConversion)
clr.AddReference("RevitServices")
import RevitServices
from RevitServices.Persistence import DocumentManager
from RevitServices.Transactions import TransactionManager

clr.AddReference("RevitAPI")
clr.AddReference("RevitAPIUI")

import Autodesk
from Autodesk.Revit.DB import *
from Autodesk.Revit.UI import *

doc = DocumentManager.Instance.CurrentDBDocument
uiapp = DocumentManager.Instance.CurrentUIApplication
app = uiapp.Application
uidoc = uiapp.ActiveUIDocument

floors_list = UnwrapElement(IN[0])
#######OK NOW YOU CAN CODE########


def get_floor_boundary_curves(floor):
    """
    This function takes a Revit floor element and returns its boundary curves based on SlabShapeCreases.

    :param floor: The Revit floor element
    :return: A tuple containing a list of boundary curves and a list of exceptions encountered
    """
    # Initialize lists to store boundary curves and exceptions
    boundary_curves = []
    exceptions = []

    # Check if the floor has a slab shape editor
    slab_shape_editor = floor.SlabShapeEditor

    # Get all creases from the slab shape editor
    slab_shape_creases = slab_shape_editor.SlabShapeCreases

    # Iterate over the creases to find boundary creases
    for crease in slab_shape_creases:
        boundary_curves.append(crease.Curve.ToProtoType())

    # Return the boundary curves and any exceptions encountered
    return boundary_curves


# Define the function to get and print the sketch profile curves from a floor
def print_floor_sketch_profile(floor):
    """
    This function takes a Revit floor element and prints its sketch profile curves.

    :param floor: The Revit floor element
    """
    doc = DocumentManager.Instance.CurrentDBDocument

    # Get the Sketch element from the floor's SketchId
    sketch_id = floor.SketchId
    sketch = doc.GetElement(sketch_id)  # Retrieve the sketch element
    output = []
    if sketch:
        # Iterate over the curve arrays in the sketch profile
        for curve_array in sketch.Profile:
            sub_output = []
            # Iterate through each curve in the curve array
            for curve in curve_array:
                sub_output.append(curve.ToProtoType())  # Print each curve's string representation
            output.append(sub_output)  # Print a blank line after each curve array
    return output


output = []
for floor in floors_list:
    curve_loop_list =  print_floor_sketch_profile(floor)
    output.append(curve_loop_list)

OUT = output
# ----------------------------------------
byGroupedCurves = PolyCurve.ByGroupedCurves(curves=getSketchCurves)
byPatch = Surface.ByPatch(closedCurve=byGroupedCurves)
area = Surface.Area(surface=byPatch)
sum = Math.Sum(values=area@@L2)
code_block_2 = CodeBlock(area=sum) { area/(100*100); }
code_block_3 = CodeBlock { 2; }
round = Math.Round(number=code_block_2, digits=code_block_3)
string_from_object = FromObject(object=round)
setParameterByName = Element.SetParameterByName(element=select_model_elements, parameterName=code_block, value=string_from_object)
